# Grasshopper definition HeaTrace_heater_generator.gh (Grasshopper 1.0.8)
# plug-ins: MeshEdit Components, Pufferfish, Human, Wallacei, Spirale

# ----
# HEATER BOUNDARY
# HEATER PLACEMENT
# Modify bounds according
# to print bed size
adjsut_placement = MDSlider(
    SliderMode=0,
    slider_value=Point(0.4553699959, 0.1963235622, 0),
    x_domain=Domain(0, 200),
    y_domain=Domain(0, 200),
    z_domain=Domain(0, 1))
# HEATER SOLVER SETUP
# Requirements:
# WALLACEI (https://www.food4rhino.com/en/app/wallacei)
length_mm = Slider(40, range=0..50)
width_mm = Slider(30, range=0..50)

# ----
# 3D PRINTER BED SIZE
# Adjust Bed size
# Preview
y_axis = Slider(200, range=0..1000)
# HeaTrace designer
x_axis = Slider(200, range=0..1000)
construct_point = ConstructPoint(XCoordinate=0, YCoordinate=0, ZCoordinate=0)
xy_plane = XYPlane(Origin=construct_point)
rectangle = Rectangle(Plane=xy_plane, XSize=x_axis, YSize=y_axis, Radius=0)  # -> Rectangle, Length
_3d_printer_bed = Curve(rectangle.Rectangle)
custom_preview_lineweights = CustomPreviewLineweights(
    Geometry=_3d_printer_bed,
    Shader=ColourSwatch(SwatchColor=RGB(103, 243, 168)),
    Thickness=Slider(7, range=0..100),
    Absolute=False)

# ----
# PARAMETERS
# Genes
# Leads length is useful
# for the interconnects
leads_length = Slider(10, range=0..100)
fillet = Slider(2.5, range=2..3.5)
trace_height = Slider(24, range=15..90)
trace_spacing = Slider(4.1, range=4..10)
array = Slider(2, range=1..10)

# ----
# HEATER TOPOLOGY
# HEATER YARN
heater_topology = ValueList({"Serepentine": 1}, selected="Serepentine")
heater_length_mm = Slider(103, range=0..1000)

# ----
# (For Serpentine)
rectangle_2 = Rectangle(Plane=adjsut_placement, XSize=length_mm, YSize=width_mm, Radius=0)  # -> Rectangle, Length
point = Point(adjsut_placement)
unit_y = UnitY(Factor=trace_height)
unit_x = UnitX(Factor=trace_spacing)
point_2 = Point(point)
curve = Curve(rectangle_2.Rectangle)
area = Area(Geometry=curve)  # -> Area, Centroid
multiplication = Multiplication(A=trace_spacing, B=Slider(2, range=0..10))
move = Move(Geometry=point_2, Motion=unit_y)  # -> Geometry, Transform
move_2 = Move(Geometry=move.Geometry, Motion=unit_x)  # -> Geometry, Transform
move_3 = Move(Geometry=point_2, Motion=unit_x)  # -> Geometry, Transform
line = Line(StartPoint=point_2, EndPoint=move.Geometry)
move_4 = Move(Geometry=move_3.Geometry, Motion=unit_x)  # -> Geometry, Transform
line_2 = Line(StartPoint=move_2.Geometry, EndPoint=move_3.Geometry)
line_3 = Line(StartPoint=move.Geometry, EndPoint=move_2.Geometry)
line_4 = Line(StartPoint=move_3.Geometry, EndPoint=move_4.Geometry)
# USER INPUTS
unit_x_2 = UnitX(Factor=multiplication)
merge = Merge(Data1=line, Data2=line_3, Data3=line_2, Data4=line_4)
linear_array = LinearArray(Geometry=merge, Direction=unit_x_2, Count=array)  # -> flatten(Geometry), Transform
list_length = ListLength(List=linear_array.Geometry)
subtraction = Subtraction(A=list_length, B=Slider(1, range=0..1))
cull_index = CullIndex(List=linear_array.Geometry, Indices=subtraction, Wrap=True)
# ALGORITHM FOR GEOMETRY CREATION
line_5 = Line(cull_index)
join_curves = JoinCurves(Curves=line_5, Preserve=False)
fillet_2 = Fillet(Curve=join_curves, Radius=fillet)
negative = Negative(Value=leads_length)
end_points = EndPoints(Curve=fillet_2)  # -> Start, End
point_3 = Point(end_points.Start)
unit_x_3 = UnitX(Factor=leads_length)
unit_x_4 = UnitX(Factor=negative)
negative_2 = Negative(Value=leads_length)
unit_y_2 = UnitY(Factor=negative)
negative_3 = Negative(Value=negative)
point_4 = Point(end_points.End)
move_5 = Move(Geometry=point_3, Motion=unit_y_2)  # -> Geometry, Transform
unit_y_3 = UnitY(Factor=negative_2)
move_6 = Move(Geometry=point_4, Motion=unit_y_3)  # -> Geometry, Transform
line_6 = Line(StartPoint=point_3, EndPoint=move_5.Geometry)
line_7 = Line(StartPoint=point_4, EndPoint=move_6.Geometry)
bounding_box = BoundingBox(Content=fillet_2, Plane=PlaneXY(0, 0, 0))  # -> Box, Box_2
length = Length(Curve=fillet_2)  # -> flatten(Length)
area_2 = Area(Geometry=bounding_box.Box)  # -> Area, Centroid
l_curve = Data(length)
merge_2 = Merge(Data1=line_6, Data2=fillet_2, Data3=line_7)
move_to_point = MoveToPoint(Geometry=merge_2, PointA=area_2.Centroid, PointB=area.Centroid)  # -> Moved, Vector, Transform
join_curves_2 = JoinCurves(Curves=move_to_point.Moved, Preserve=False)

# ----
# Gecko boundary
# Activate "Preview" to show
geometry = Geometry(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)

# ----
# SPIRAL
# ADJUST PLACEMENT
# PARAMETERS
# Leads length is useful
# for the interconnects
# Modify bounds according
# to print bed size
# Rotate/Orient the heater in 2D
md_slider_123 = MDSlider(
    SliderMode=0,
    slider_value=Point(0.500845188, 0.4678980013, 0),
    x_domain=Domain(0, 200),
    y_domain=Domain(0, 200),
    z_domain=Domain(0, 1))
rotate = Slider(0, range=0..360)
leads_length_1 = Slider(25, range=0..100)
leads_length_2 = Slider(15, range=0..100)
turncount = Slider(3, range=0..10)
external_radius = Slider(13, range=0..100)
division = Division(A=external_radius, B=turncount)
spacing = Panel(division)

# ----
# SQUARE SEREPENTINE
# ADJUST PLACEMENT
# PARAMETERS
# Leads length is useful
# for the interconnects
# Modify bounds according
# to print bed size
# Rotate/Orient the heater in 2D
adjsut_placement_2 = MDSlider(
    SliderMode=0,
    slider_value=Point(0.4491201261, 0.4643899685, 0),
    x_domain=Domain(0, 200),
    y_domain=Domain(0, 200),
    z_domain=Domain(0, 1))
rotate_2 = Slider(0, range=0..360)
fillet_3 = Slider(3.5, range=0..10)
leads_length_3 = Slider(10, range=0..100)
trace_height_2 = Slider(20, range=0..100)
trace_spacing_2 = Slider(4, range=0..20)
array_2 = Slider(3, range=0..10)

z_lift = Slider(1, range=0..10)

unit_x_5 = UnitX(Factor=trace_spacing_2)
unit_y_4 = UnitY(Factor=trace_height_2)
point_5 = Point(adjsut_placement_2)
move_7 = Move(Geometry=point_5, Motion=unit_y_4)  # -> Geometry, Transform
move_8 = Move(Geometry=move_7.Geometry, Motion=unit_x_5)  # -> Geometry, Transform
move_9 = Move(Geometry=point_5, Motion=unit_x_5)  # -> Geometry, Transform
multiplication_2 = Multiplication(A=trace_spacing_2, B=Slider(2, range=0..10))
line_8 = Line(StartPoint=point_5, EndPoint=move_7.Geometry)
line_9 = Line(StartPoint=move_8.Geometry, EndPoint=move_9.Geometry)
line_10 = Line(StartPoint=move_7.Geometry, EndPoint=move_8.Geometry)
move_10 = Move(Geometry=move_9.Geometry, Motion=unit_x_5)  # -> Geometry, Transform
unit_x_6 = UnitX(Factor=multiplication_2)
line_11 = Line(StartPoint=move_9.Geometry, EndPoint=move_10.Geometry)
merge_3 = Merge(Data1=line_8, Data2=line_10, Data3=line_9, Data4=line_11)
# ALGORITHM FOR GEOMETRY CREATION
linear_array_2 = LinearArray(Geometry=merge_3, Direction=unit_x_6, Count=array_2)  # -> flatten(Geometry), Transform
list_length_2 = ListLength(List=linear_array_2.Geometry)
subtraction_2 = Subtraction(A=list_length_2, B=Slider(1, range=0..1))
cull_index_2 = CullIndex(List=linear_array_2.Geometry, Indices=subtraction_2, Wrap=True)
line_12 = Line(cull_index_2)
join_curves_3 = JoinCurves(Curves=line_12, Preserve=False)
fillet_4 = Fillet(Curve=join_curves_3, Radius=fillet_3)
unit_x_7 = UnitX(Factor=leads_length_3)
end_points_2 = EndPoints(Curve=fillet_4)  # -> Start, End
negative_4 = Negative(Value=leads_length_3)
negative_5 = Negative(Value=leads_length_3)
point_6 = Point(end_points_2.Start)
point_7 = Point(end_points_2.End)
negative_6 = Negative(Value=negative_4)
unit_y_5 = UnitY(Factor=negative_5)
unit_y_6 = UnitY(Factor=negative_4)
unit_x_8 = UnitX(Factor=negative_4)
move_11 = Move(Geometry=point_7, Motion=unit_y_5)  # -> Geometry, Transform
move_12 = Move(Geometry=point_6, Motion=unit_y_6)  # -> Geometry, Transform
line_13 = Line(StartPoint=point_6, EndPoint=move_12.Geometry)
line_14 = Line(StartPoint=point_7, EndPoint=move_11.Geometry)
bounding_box_2 = BoundingBox(Content=fillet_4, Plane=PlaneXY(0, 0, 0))  # -> Box, Box_2
merge_4 = Merge(Data1=line_13, Data2=fillet_4, Data3=line_14)
mesh_area = MeshArea(Mesh=bounding_box_2.Box)  # -> Area, Centroid
join_curves_4 = JoinCurves(Curves=merge_4, Preserve=False)
curve_2 = Curve(join_curves_4)
rotate_3 = Rotate(Geometry=curve_2, Angle=degrees(rotate_2), Plane=mesh_area.Centroid)  # -> Geometry, Transform

unit_z = UnitZ(Factor=1)
spirale = Spirale(
    AxisStart=md_slider_123,
    AxisDirection=unit_z,
    HelixStart=Point(0, 1, 0),
    Pitch=Slider(0, range=0..10),
    TurnCount=turncount,
    R1=Slider(0, range=0..10),
    R2=external_radius)
negative_7 = Negative(Value=leads_length_2)
negative_8 = Negative(Value=leads_length_1)
curve_3 = Curve(spirale)
unit_y_7 = UnitY(Factor=negative_7)
end_points_3 = EndPoints(Curve=curve_3)  # -> Start, End
# ALGORITHM FOR GEOMETRY CREATION
unit_y_8 = UnitY(Factor=negative_8)
unit_z_2 = UnitZ(Factor=z_lift)
point_8 = Point(end_points_3.End)
move_13 = Move(Geometry=point_8, Motion=unit_y_7)  # -> Geometry, Transform
move_14 = Move(Geometry=end_points_3.Start, Motion=unit_y_8)  # -> Geometry, Transform
move_15 = Move(Geometry=end_points_3.Start, Motion=unit_z_2)  # -> Geometry, Transform
line_15 = Line(StartPoint=point_8, EndPoint=move_13.Geometry)
line_16 = Line(StartPoint=end_points_3.Start, EndPoint=move_15.Geometry)
end_points_4 = EndPoints(Curve=line_16)  # -> Start, End
point_9 = Point(end_points_4.End)
line_17 = Line(StartPoint=point_9, EndPoint=move_14.Geometry)
bounding_box_3 = BoundingBox(Content=curve_3, Plane=PlaneXY(0, 0, 0))  # -> Box, Box_2
mesh_area_2 = MeshArea(Mesh=bounding_box_3.Box)  # -> Area, Centroid
merge_5 = Merge(Data1=curve_3, Data2=line_15, Data3=line_17, Data4=line_16)
join_curves_5 = JoinCurves(Curves=merge_5, Preserve=False)
curve_4 = Curve(join_curves_5)
rotate_4 = Rotate(Geometry=curve_4, Angle=degrees(rotate), Plane=mesh_area_2.Centroid)  # -> Geometry, Transform

# ----
# HEATER BOUNDARY
# Adjust Heater Boundary
# Choose the heater topology
# to wrap the boundary
# Preview
xy_plane_2 = XYPlane(Origin=Point(0, 0, 0))
x = Slider(30, range=0..100)
y = Slider(30, range=0..100)
heater_toplogy = ValueList({"Serpentine": 0, "Spiral": 1}, selected="Serpentine")
rectangle_3 = Rectangle(Plane=xy_plane_2, XSize=x, YSize=y, Radius=0)  # -> Rectangle, Length
pick_n_choose = PickNChoose(Pattern=heater_toplogy, Stream0=mesh_area.Centroid, Stream1=mesh_area_2.Centroid)
area_3 = Area(Geometry=rectangle_3.Rectangle)  # -> Area, Centroid
move_to_point_2 = MoveToPoint(Geometry=rectangle_3.Rectangle, PointA=area_3.Centroid, PointB=pick_n_choose)  # -> Moved, Vector, Transform
custom_preview_lineweights_2 = CustomPreviewLineweights(
    Geometry=move_to_point_2.Moved,
    Shader=ColourSwatch(SwatchColor=RGB(51, 206, 176)),
    Thickness=Slider(5, range=0..10),
    Absolute=False)

# ----
# Objective functions
move_to_point_3 = MoveToPoint(Geometry=fillet_2, PointA=area_2.Centroid, PointB=area.Centroid)  # -> Moved, Vector, Transform
bounding_box_4 = BoundingBox(Content=move_to_point_3.Moved, Plane=PlaneXY(0, 0, 0))  # -> Box, Box_2
negative_9 = Negative(Value=Slider(3, range=0..10))
curve_5 = Curve(curve)
deconstruct_box = DeconstructBox(Box=bounding_box_4.Box)  # -> Plane, X, Y, Z
offset_curve = OffsetCurve(Curve=curve_5, Distance=negative_9, Corners=1)
# ALGORITHM FOR WALLACEI SOLVING
p_w = Number(deconstruct_box.X)
p_h = Number(deconstruct_box.Y)
bounding_box_5 = BoundingBox(Content=offset_curve, Plane=PlaneXY(0, 0, 0))  # -> Box, Box_2
deconstruct_box_2 = DeconstructBox(Box=bounding_box_5.Box)  # -> Plane, X, Y, Z
h_max = Number(deconstruct_box_2.Y)
w_max = Number(deconstruct_box_2.X)
expression = Expression(P_W=p_w, W_max=w_max, P_H=p_h, H_max=h_max, Expression="If(((P_W ≤ W_max) and (P_H ≤ H_max)), 0, 1)")
expression_2 = Expression(L_curve=l_curve, L_yarn=heater_length_mm, Expression="Abs(L_curve - L_yarn)")
haf = Number(flatten(expression))
lgh_lih = Number(flatten(expression_2))
# For flat surface, Concentric slice
# Circle
phenotype = Geometry(move_to_point_3.Moved)  # disabled

# ----
# Optimized Heater geometry
# after Parametric search
serpentne_heater = Geometry(join_curves_2)
# Activate "Preview" to show
# the respective heater
spiral_heater = Geometry(rotate_4.Geometry)
serpentne_heater_2 = Geometry(rotate_3.Geometry)

# ----
# Connect to
# respective Heater
number_slider = Slider(200, range=0..1000)
# TOOLPATH CREATION
curve_6 = Curve(serpentne_heater_2)
divide_curve = DivideCurve(Curve=curve_6, Count=number_slider, Kinks=False)  # -> Points, Tangents, Parameters
# Control
# commands
pdecon = Deconstruct(Point=divide_curve.Points)  # -> XComponent, YComponent, ZComponent
number_slider_2 = Slider(100, range=0..100)
number_slider_3 = Slider(100, range=0..100)
multiplication_3 = Multiplication(A=pdecon.XComponent, B=number_slider_3)
multiplication_4 = Multiplication(A=pdecon.YComponent, B=number_slider_2)
int = Integer(multiplication_3)
int_2 = Integer(multiplication_4)
division_2 = Division(A=int, B=number_slider_3)
division_3 = Division(A=int_2, B=number_slider_2)
concat = Concatenate(
    FragmentH="G1 ",
    FragmentA="X",
    FragmentB=division_2,
    FragmentC=" Y",
    FragmentD=division_3,
    FragmentE=" Z",
    FragmentF=Slider(0, range=0..100),
    FragmentG=" F1000")  # -> flatten(Result)
merge_6 = Merge(Data1="M7", Data2=concat, Data3="M9")

# ----
# Double click to setup and
# launch the solver
wallacei_x = WallaceiX(
    Genes=[trace_height, trace_spacing, array],
    Objectives=[haf, lgh_lih],
    Phenotype=phenotype,
    allFitness="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",
    allFrontIdx="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",
    allGenomes="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",
    curFrontIdx="99|0;99|1;99|2;99|3;99|4;99|5;99|6;99|7;99|8;99|9;99|10;99|11;99|12;99|13;99|14;99|15;99|16;99|17;99|18;99|19",
    curFrontIdxSave="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",
    popGen="20,100",
    total="25500",
    wlcDone=True)  # -> WallaceiGenomes, FitnessValues, Data, Phenotypes
# For flat surface, Concentric slice
# For flat surface, cross slice
g_code_for_afe = Panel(merge_6)
